# Grasshopper definition Merge.gh (Grasshopper 1.0.4)

panel = Panel("""5
5
5
5
5
5
5
5
4
4
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""")
panel_2 = Panel("""2
2
1
3
1
4
1
2
2
2
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""")
panel_3 = Panel("""16
16
16
16
16
16
16
16
16""")
merge = GhPythonScript(floors=panel, cells=panel_2, borders=panel_3)  # -> out, a; inputs floors: list, cells: list, borders: list
# ---------- merge: Python ----------
import itertools

def select_by_number(items, n):
    result = []
    counter = 0
    for i in items:
        if counter >= n:
            break
        result.append(i)
        counter += i
    return result


def split(items, borders):
    buffer = items
    result = []
    for border in borders:
        r = select_by_number(buffer, border)
        result.append(r)
        buffer = buffer[len(r):]
    return result


def sum_items(items):
    xs = [sum(x) if isinstance(x, tuple) else x for x in items]
    return sum(xs)


def get_merge(items):
    return tuple(items)


def merge_offset(items, value, start, offset):
    length = len(items)
    i = offset
    while True:
        end = start + i

        if 0 <= end <= length:
            sublist = items[start:end]
            s = sum_items(sublist)

            if s == value:
                return items[:start] + [get_merge(sublist)] + items[end:]

            if s > value:
                return None

            i += offset
        else:
            break
    return None


def merge(items, n):
    m = n - 1
    s = 0
    while True:
        if m == 0:
            break

        if m not in items:
            m -= 1
            s = 0
            continue

        try:
            s = items.index(m, s)
        except ValueError as e:
            m -= 1
            s = 0
            continue

        mo = merge_offset(items, n, s, 1)
        if mo:
            return mo

        mo = merge_offset(items, n, s, -1)
        if mo:
            return mo

        s += 1

    return None


def merge_all(floors, cell_groups):
    groups = len(cell_groups)
    cg_index = 0

    # print('Before')
    # for cg in cell_groups:
    #     print(cg)
    # print(sum(list(itertools.chain.from_iterable(cell_groups))))

    while len(floors) > 0:
        f = floors.pop(0)
        cg = cell_groups[cg_index]

        cg = merge(cg, f)

        if not cg:
            break

        cell_groups[cg_index] = cg
        cg_index = (cg_index + 1) % groups

    # print('Merged')
    # for cg in cell_groups:
    #     print(cg)
    # print(sum_items(list(itertools.chain.from_iterable(cell_groups))))

    return cell_groups


def pack_tuple(items):
    return [x if isinstance(x, tuple) else (x,) for x in items]


def main(floors, cells, borders):
    cell_groups = split(cells, borders)

    return merge_all(floors, cell_groups)

floors = list(map(int, floors))
cells = list(map(int, cells))
borders = list(map(int, borders))

result = main(floors=floors, cells=cells, borders=borders)
result = [pack_tuple(x) for x in result]

def is_iterable(item):
    """If list or tuple"""
    return hasattr(item, '__iter__')


def list_to_tree(input):
    """Transforms nestings of lists or tuples to a Grasshopper DataTree"""
    from Grasshopper import DataTree as Tree
    from Grasshopper.Kernel.Data import GH_Path as Path
    from System import Array

    def proc(input, tree, track):
        path = Path(Array[int](track))

        for i, item in enumerate(input):
            if is_iterable(item):
                track.append(i)
                proc(item, tree, track)
                track.pop()
            else:
                tree.Add(item, path)

    tree = Tree[object]()
    proc(input, tree, [0])
    return tree

a = list_to_tree(result)
print(result)
# ---------- end merge ----------
panel_4 = Panel(merge.a)
